# Grasshopper definition complexDemo.gh (Grasshopper 1.0.7)
# plug-ins: GHUI

# ----
# Create Individual UI Components
panel = Panel("mySlider1")
create_header = CreateHeader(Name="header", ID="MyTitle", Value="My Web Interface", Scale=1, CSS="font-family:Arial;")
create_header_2 = CreateHeader(
    Name="header",
    ID="header",
    Value="A Web-based user-interface package for Grasshopper!",
    Scale="3",
    CSS="font-family:Arial;")
create_slider = CreateSlider(Name=panel, ID=panel, Value=50, Min=0, Max=100)
create_slider_2 = CreateSlider(Name="mySlider2", ID="mySlider2", Value=50, Min=0, Max=100)
create_button = CreateButton(Name="myButton", ID="myButton", Value="Run My script")

# ----
# Select Where to Create the HTML UI
file_path = FilePath("D:\Documents\Project\yinhua\custom-gh-web-ui\usage\pages\gh-web-ui-complex-demo.html")
html_ui_file_will_be_written_here = Panel(file_path)

panel_2 = Panel("Layout & Styling")
wrap_in_div = WrapInDiv(HTML=create_slider)
wrap_in_div_2 = WrapInDiv(HTML=create_slider_2)

concatenate = Concatenate(FragmentA=create_header, FragmentB=create_button)
concatenate_2 = Concatenate(FragmentA=concatenate, FragmentB=create_header_2)
# Combine UI Elements into Single Interface
concatenate_3 = Concatenate(FragmentA=concatenate_2, FragmentB=wrap_in_div)
concatenate_4 = Concatenate(FragmentA=concatenate_3, FragmentB=wrap_in_div_2)

# ----
# Create Components to Displat Results
panel_3 = Panel("Distance in Rhino:")
create_header_3 = CreateHeader(Name="header", ID="header", Value=panel_3, Scale="3", CSS="font-family:Arial;")
create_header_4 = CreateHeader(Name="header", ID="MyLabel", Value="header", Scale="3", CSS="font-family:Arial;")
panel_4 = Panel("""width:100%;
height:100px;
background:lightgray;""")

concatenate_5 = Concatenate(FragmentA=create_header_3, FragmentB=create_header_4)

wrap_in_div_3 = WrapInDiv(HTML=concatenate_5, CSS=panel_4)

concatenate_6 = Concatenate(FragmentA=concatenate_4, FragmentB=wrap_in_div_3)
build_html_ui = BuildHTMLUI(HTMLPath=file_path, HTMLString=concatenate_6, Title="UI")  # -> Success, Path
panel_5 = Panel(concatenate_6)

panel_6 = Panel("Launch FUll UI")
launch_html_ui = LaunchHTMLUI(HTMLPath=build_html_ui.Path, ShowWindow=Toggle(True), Title="UI")  # -> InputValues, InputIds, InputNames, InputTypes, WebWindow
panel_7 = Panel(launch_html_ui.InputNames)
panel_8 = Panel(launch_html_ui.InputValues)
panel_9 = Panel(launch_html_ui.InputTypes)
panel_10 = Panel(launch_html_ui.InputIds)

panel_11 = Panel(build_html_ui.Success)

# ----
# Use Inputs in Grasshopper!
panel_12 = Panel("1")
list_item = ListItem(List=panel_8, Index=panel_12, Wrap=True)
list_item_2 = ListItem(List=panel_8, Index="2", Wrap=True)
vector_xyz = VectorXYZ(XComponent=list_item_2, YComponent=list_item_2, ZComponent=list_item_2)  # -> Vector, Length
vector_xyz_2 = VectorXYZ(XComponent=list_item, YComponent=list_item, ZComponent=list_item)  # -> Vector, Length
line = Line(StartPoint=vector_xyz_2.Vector, EndPoint=vector_xyz.Vector)
distance = Distance(PointA=vector_xyz_2.Vector, PointB=vector_xyz.Vector)
distance_between_points = Panel(distance)

# ----
# Set Values Based on Grasshopper-Computed Output
panel_13 = Panel("0")
define_set_values = DefineSetValues(IDs="MyLabel", Values=distance)
set_values = SetValues(WebWindow=launch_html_ui.WebWindow, Setters=define_set_values)
