# Grasshopper definition FuyaoFDA.gh (Grasshopper 1.0.7)
# plug-ins: Human UI, Dhictionary, EF - R7 Beta, GHUI

file_path = FilePath("D:\Documents\Project\yinhua\gh-web-ui\custom-usage\project\index.html")
panel = Panel(file_path)
launch_html_ui = LaunchHTMLUI(HTMLPath=file_path, ShowWindow=Toggle(True), Title="福耀玻璃印花填充工具")  # -> InputValues, InputIds, InputNames, InputTypes, WebWindow
panel_2 = Panel("A_OuterEdge")
panel_3 = Panel("A_InnerEdge")
panel_4 = Panel("A_ReferEdge")
id_of_elements_in_ui = Panel(launch_html_ui.InputIds)
values_of_elements_in_ui = Panel(launch_html_ui.InputValues)
boolean = Boolean(False)
panel_5 = Panel("这后面需要完成一个按下按钮后鼠标点选线的操作...")
sub_list = SubList(List=values_of_elements_in_ui, Domain="(7,9)", Wrap=boolean)  # -> List, Index
list_item = ListItem(List=sub_list.List, Index="0", Wrap=True)
holeouterclick = Panel(list_item)
equality = Equality(FirstNumber=holeouterclick, SecondNumber="-1")  # -> Equality, Inequality
mesh = Mesh()
ghpython_script = GhPythonScript()  # -> out, a
# ---------- ghpython_script: Python ----------
__author__ = "USER"
__version__ = "2022.05.23"

import rhinoscriptsyntax as rs
import scriptcontext as sc
import Rhino
a = sc.sticky["times"]

print(sc.sticky["mainWindow"]["holeAreaIndex"])
sc.doc = Rhino.RhinoDoc.ActiveDoc
print("HoleBlock{}".format(sc.sticky["mainWindow"]["holeAreaIndex"]))
print(sc.sticky)
sc.doc = ghdoc
print("HoleBlock{}".format(sc.sticky["mainWindow"]["holeAreaIndex"]))
print(sc.sticky)
sc.doc = Rhino.RhinoDoc.ActiveDoc
for obj in rs.ObjectsByName("HoleBlock1"):
    print(type(obj))
# ---------- end ghpython_script ----------
panel_6 = Panel(ghpython_script.a)

panel_7 = Panel("""1
2
3""")
boolean_2 = Boolean(True)
create_radio_button = CreateRadioButton(RadioButtonName="孔状区域", RadioButtonGroup="TypeSelection", InitiallySelected=boolean_2)
create_radio_button_2 = CreateRadioButton(RadioButtonName="块状区域", RadioButtonGroup="TypeSelection", InitiallySelected=False)
create_radio_button_3 = CreateRadioButton(RadioButtonName="带状区域", RadioButtonGroup="TypeSelection", InitiallySelected=False)
create_true_only_button = CreateTrueOnlyButton(ButtonName="开始填充", ButtonStyle=0)
create_true_only_button_2 = CreateTrueOnlyButton(ButtonName="编辑填充", ButtonStyle=0)
create_label = CreateLabel(LabelText="孔状区域", LabelSize=12, Justification=0)
create_label_2 = CreateLabel(LabelText="编辑已填充区域", LabelSize=12, Justification=0)
value_listener = ValueListener(Elements=create_radio_button, SomeProperty=True)  # -> Values, Indices
value_listener_2 = ValueListener(Elements=create_radio_button_2, SomeProperty=True)  # -> Values, Indices
value_listener_3 = ValueListener(Elements=create_radio_button_3, SomeProperty=True)  # -> Values, Indices
value_listener_4 = ValueListener(Elements=create_true_only_button, SomeProperty=True)  # -> Values, Indices
value_listener_5 = ValueListener(Elements=create_true_only_button_2, SomeProperty=True)  # -> Values, Indices
number_slider = Slider(500, range=0..1000)
boolean_3 = Boolean(True)
ghpython_script_2 = GhPythonScript(okay=value_listener_5.Values, key="windowTransition", mainWindowKey="mainWindow")  # -> out, show, NullTrigger
# ---------- ghpython_script_2: Python ----------
__author__ = "USER"
__version__ = "2022.05.22"

import rhinoscriptsyntax as rs

import scriptcontext as sc

if not sc.sticky.has_key(key):
    sc.sticky[key] = {}
    
if okay:
    sc.sticky[key]["readInnerEdgeFromArchive"] = True
    sc.sticky[key]["readOuterEdgeFromArchive"] = True
    sc.sticky[key]["readReferEdgeFromArchive"] = True
    
    
    sc.sticky[key]["readRadiusFromArchive"] = True
    sc.sticky[key]["readHspaceFromArchive"] = True
    sc.sticky[key]["readVspaceFromArchive"] = True
    sc.sticky[key]["readHorizontalFromArchive"] = True
    sc.sticky[key]["readVerticalFromArchive"] = True
    
    sc.sticky[mainWindowKey]["holeAreaIndex"] = sc.sticky[mainWindowKey]["holeAreaIndexCandidate"]
    
    show = True
# ---------- end ghpython_script_2 ----------
ghpython_script_3 = GhPythonScript(okay=value_listener_4.Values, key="mainWindow")  # -> out, isHoleWindow, isBlockWindow, isBandWindow
# ---------- ghpython_script_3: Python ----------
__author__ = "USER"
__version__ = "2022.05.22"

import scriptcontext as sc

if okay:
    isHoleWindow = sc.sticky[key]["isHole"]
    isBlockWindow = sc.sticky[key]["isBlock"]
    isBandWindow = sc.sticky[key]["isBand"]
    
    if sc.sticky.has_key("metadata"):
        sc.sticky[key]["holeAreaIndex"] = sc.sticky["metadata"] + 1
    else:
        sc.sticky[key]["holeAreaIndex"] = 1
# ---------- end ghpython_script_3 ----------
ghpython_script_4 = GhPythonScript(key="mainWindow", isHole=value_listener.Values, isBlock=value_listener_2.Values, isBand=value_listener_3.Values)  # -> out
# ---------- ghpython_script_4: Python ----------
__author__ = "USER"
__version__ = "2022.05.22"

import scriptcontext as sc

sc.sticky[key] = {}
sc.sticky[key]["isHole"] = isHole
sc.sticky[key]["isBlock"] = isBlock
sc.sticky[key]["isBand"] = isBand
# ---------- end ghpython_script_4 ----------
ghpython_script_5 = GhPythonScript(okay=value_listener_5.Values, key="mainWindow")  # -> out, holeAreaIndex
# ---------- ghpython_script_5: Python ----------
__author__ = "USER"
__version__ = "2022.05.22"

import rhinoscriptsyntax as rs
import scriptcontext as sc

print(okay)
if okay:
    holeAreaIndex = sc.sticky[key]["holeAreaIndex"]
print(holeAreaIndex)
# ---------- end ghpython_script_5 ----------
launch_window = LaunchWindow(Show=boolean_3, Name="Control Window", Width=number_slider, Height=number_slider, ChildStatus=0, EnableHorizScroll=False)
ghpython_script_6 = GhPythonScript(okay=value_listener_4.Values, key="windowTransition")  # -> out, a, NullTrigger
# ---------- ghpython_script_6: Python ----------
__author__ = "USER"
__version__ = "2022.05.22"

import rhinoscriptsyntax as rs
import scriptcontext as sc

if not sc.sticky.has_key(key):
    sc.sticky[key] = {}
    
if okay:
    sc.sticky[key]["readInnerEdgeFromArchive"] = False
    sc.sticky[key]["readOuterEdgeFromArchive"] = False
    sc.sticky[key]["readReferEdgeFromArchive"] = False
    
    sc.sticky[key]["readRadiusFromArchive"] = False
    sc.sticky[key]["readHspaceFromArchive"] = False
    sc.sticky[key]["readVspaceFromArchive"] = False
    sc.sticky[key]["readHorizontalFromArchive"] = False
    sc.sticky[key]["readVerticalFromArchive"] = False
# ---------- end ghpython_script_6 ----------
create_label_3 = CreateLabel(LabelText="填充类型", LabelSize=12, Justification=0)
占位 = Panel("")
create_label_4 = CreateLabel(LabelText=占位, LabelSize=12, Justification=0)
merge = Merge(
    Data1=create_label_3,
    Data2=create_radio_button,
    Data3=create_radio_button_2,
    Data4=create_radio_button_3,
    Data5=create_true_only_button)
create_label_5 = CreateLabel(LabelText="福耀印花填充", LabelSize=Slider(44, range=0..100), Justification="1")
boolean_4 = Boolean(False)
boolean_5 = Boolean(False)
create_stack = CreateStack(UIElements=merge, Horizontal=boolean_4)
create_border = CreateBorder(UIElement=create_stack, BorderThickness=5, BorderColor=RGB(0, 0, 0), CornerRadius=0)

num = Number(4)

number_slider_2 = Slider(1000, range=0..1000)
ghpython_script_7 = GhPythonScript(show=ghpython_script_3.isHoleWindow, show2=ghpython_script_2.show)  # -> out, a
# ---------- ghpython_script_7: Python ----------
__author__ = "USER"
__version__ = "2022.05.22"

import rhinoscriptsyntax as rs

if show is None and show2 is None:
    a = False
else:
    a = show
# ---------- end ghpython_script_7 ----------
launch_window_2 = LaunchWindow(
    Show=ghpython_script_7.a,
    Name="Control Window",
    Width=number_slider_2,
    Height=number_slider_2,
    ChildStatus=0,
    EnableHorizScroll=False)
boolean_6 = Boolean(False)
boolean_7 = Boolean(False)
boolean_8 = Boolean(False)
boolean_9 = Boolean(False)
boolean_10 = Boolean(False)
boolean_11 = Boolean(False)
boolean_12 = Boolean(False)
boolean_13 = Boolean(False)
create_rhino_pick_button = CreateRhinoPickButton(
    ButtonName="Pick inner edge",
    Prompt="Please select geometry...",
    AllowMultiple=boolean_7,
    AllowNone=boolean_6,
    Type="2",
    ButtonStyle=0)
create_rhino_pick_button_2 = CreateRhinoPickButton(
    ButtonName="Pick refer edge",
    Prompt="Please select geometry...",
    AllowMultiple=boolean_10,
    AllowNone=boolean_8,
    Type="2",
    ButtonStyle=0)
create_rhino_pick_button_3 = CreateRhinoPickButton(
    ButtonName="Pick outer edge",
    Prompt="Please select geometry...",
    AllowMultiple=boolean_11,
    AllowNone=boolean_9,
    Type="2",
    ButtonStyle=0)
boolean_14 = Boolean(False)
boolean_15 = Boolean(False)
create_true_only_button_3 = CreateTrueOnlyButton(ButtonName="Generate & Save Meshes", ButtonStyle=0)
create_true_only_button_4 = CreateTrueOnlyButton(ButtonName="Open InstantMeshes", ButtonStyle=0)
boolean_16 = Boolean(False)
create_text_box = CreateTextBox(Label="vertical", DefaultText="0.1", UpdateButton=boolean_12, showLabel=True)
create_text_box_2 = CreateTextBox(Label="Radius", DefaultText="0.425 0.6 0.85", UpdateButton=boolean_16, showLabel=True)
create_text_box_3 = CreateTextBox(Label="hsapce", DefaultText="2.2", UpdateButton=boolean_14, showLabel=True)
create_text_box_4 = CreateTextBox(Label="horizontal", DefaultText="0.1", UpdateButton=boolean_13, showLabel=True)
create_text_box_5 = CreateTextBox(Label="vspace", DefaultText="1.4 1.7", UpdateButton=boolean_15, showLabel=True)
value_listener_6 = ValueListener(Elements=create_true_only_button_4, SomeProperty=True)  # -> Values, Indices
value_listener_7 = ValueListener(Elements=create_true_only_button_3, SomeProperty=True)  # -> Values, Indices
value_listener_8 = ValueListener(Elements=create_rhino_pick_button, SomeProperty=True)  # -> Values, Indices
value_listener_9 = ValueListener(Elements=create_rhino_pick_button_2, SomeProperty=True)  # -> Values, Indices
value_listener_10 = ValueListener(Elements=create_rhino_pick_button_3, SomeProperty=True)  # -> Values, Indices
create_true_only_button_5 = CreateTrueOnlyButton(ButtonName="Apply", ButtonStyle=0)
value_listener_11 = ValueListener(Elements=create_text_box_2, SomeProperty=True)  # -> Values, Indices
value_listener_12 = ValueListener(Elements=create_text_box_4, SomeProperty=True)  # -> Values, Indices
value_listener_13 = ValueListener(Elements=create_text_box_5, SomeProperty=True)  # -> Values, Indices
ghpython_script_8 = GhPythonScript(holeWindowKey="holeWindow", okay=value_listener_6.Values)  # -> out, okay
# ---------- ghpython_script_8: Python ----------
__author__ = "USER"
__version__ = "2022.05.25"

import rhinoscriptsyntax as rs
import scriptcontext as sc

if okay:
    sc.sticky[holeWindowKey]["open_instant_meshes"] = True
# ---------- end ghpython_script_8 ----------
value_listener_14 = ValueListener(Elements=create_text_box, SomeProperty=True)  # -> Values, Indices
value_listener_15 = ValueListener(Elements=create_text_box_3, SomeProperty=True)  # -> Values, Indices
ghpython_script_9 = GhPythonScript(holeWindowKey="holeWindow", okay=value_listener_7.Values)  # -> out, okay
# ---------- ghpython_script_9: Python ----------
__author__ = "USER"
__version__ = "2022.05.25"

import rhinoscriptsyntax as rs
import scriptcontext as sc

if okay:
    sc.sticky[holeWindowKey]["generate_save_meshes"] = True
# ---------- end ghpython_script_9 ----------
value_listener_16 = ValueListener(Elements=create_true_only_button_5, SomeProperty=True)  # -> Values, Indices
python = GhPythonScript(
    key="windowTransition",
    ID=value_listener_10.Values,
    archiveID=ghpython_script_5.holeAreaIndex,
    NullTrigger=ghpython_script_6.NullTrigger,
    NullTrigger2=ghpython_script_2.NullTrigger)  # -> out, obj_id, obj, name
#   port out: The Rhino object variable
# ---------- python: Python ----------
__author__ = "jinxinqi"
__version__ = "2022.05.06"

import rhinoscriptsyntax as rs
import scriptcontext as sc
import ghpythonlib.components as ghcomp
import Rhino
import System


def convertStrToArrayByte(input):
    rtn = array.array("b")
    for i in range(len(input)):
        rtn.append('y')
    return rtn

doc = Rhino.RhinoDoc.ActiveDoc

readFromArchive = sc.sticky[key]["readOuterEdgeFromArchive"]

obj_id = None
try:
    if not readFromArchive:
        obj_id = str(ID)
        #print("new ID used: {}".format(type(obj_id)))
        print("new ID used: {}".format(System.Guid(obj_id)))
        #print("new ID used: {}".format(ID.ToByteArray.__str__()))
    else:
        obj_id = str(sc.sticky["data"][int(archiveID)-1]["outerEdge"])
        print("archived ID used: {}".format(System.Guid(obj_id)))
except:
    pass
    
sc.sticky[key]["readOuterEdgeFromArchive"] = False

if obj_id is not None:
    obj = doc.Objects.Find(System.Guid(obj_id))
    print(obj)
    name = obj.Name
    print(name)
# ---------- end python ----------
python_2 = GhPythonScript(
    key="windowTransition",
    ID=value_listener_8.Values,
    archiveID=ghpython_script_5.holeAreaIndex,
    NullTrigger=ghpython_script_6.NullTrigger,
    NullTrigger2=ghpython_script_2.NullTrigger)  # -> out, obj_id, obj, name
#   port out: The Rhino object variable
# ---------- python_2: Python ----------
__author__ = "jinxinqi"
__version__ = "2022.05.06"

import rhinoscriptsyntax as rs
import scriptcontext as sc
import ghpythonlib.components as ghcomp
import Rhino
import System


def convertStrToArrayByte(input):
    rtn = array.array("b")
    for i in range(len(input)):
        rtn.append('y')
    return rtn

doc = Rhino.RhinoDoc.ActiveDoc

readFromArchive = sc.sticky[key]["readInnerEdgeFromArchive"]

obj_id = None
try:
    if not readFromArchive:
        obj_id = str(ID)
        #print("new ID used: {}".format(type(obj_id)))
        print("new ID used: {}".format(System.Guid(obj_id)))
        #print("new ID used: {}".format(ID.ToByteArray.__str__()))
    else:
        obj_id = str(sc.sticky["data"][int(archiveID)-1]["innerEdge"])
        print("archived ID used: {}".format(System.Guid(obj_id)))
except:
    pass
    
sc.sticky[key]["readInnerEdgeFromArchive"] = False

if obj_id is not None:
    obj = doc.Objects.Find(System.Guid(obj_id))
    print(obj)
    name = obj.Name
    print(name)
# ---------- end python_2 ----------
python_3 = GhPythonScript(
    key="windowTransition",
    ID=value_listener_9.Values,
    archiveID=ghpython_script_5.holeAreaIndex,
    NullTrigger=ghpython_script_6.NullTrigger,
    NullTrigger2=ghpython_script_2.NullTrigger)  # -> out, obj_id, obj, name
#   port out: The Rhino object variable
# ---------- python_3: Python ----------
__author__ = "jinxinqi"
__version__ = "2022.05.06"

import rhinoscriptsyntax as rs
import scriptcontext as sc
import ghpythonlib.components as ghcomp
import Rhino
import System


def convertStrToArrayByte(input):
    rtn = array.array("b")
    for i in range(len(input)):
        rtn.append('y')
    return rtn

doc = Rhino.RhinoDoc.ActiveDoc

readFromArchive = sc.sticky[key]["readReferEdgeFromArchive"]

obj_id = None
try:
    if not readFromArchive:
        obj_id = str(ID)
        #print("new ID used: {}".format(type(obj_id)))
        print("new ID used: {}".format(System.Guid(obj_id)))
        #print("new ID used: {}".format(ID.ToByteArray.__str__()))
    else:
        obj_id = str(sc.sticky["data"][int(archiveID)-1]["referEdge"])
        print("archived ID used: {}".format(System.Guid(obj_id)))
except:
    pass
    
sc.sticky[key]["readReferEdgeFromArchive"] = False

if obj_id is not None:
    obj = doc.Objects.Find(System.Guid(obj_id))
    print(obj)
    name = obj.Name
    print(name)
# ---------- end python_3 ----------
ghpython_script_10 = GhPythonScript(
    key="windowTransition",
    value=value_listener_11.Values,
    archiveID=ghpython_script_5.holeAreaIndex,
    NullTrigger=ghpython_script_6.NullTrigger,
    NullTrigger2=ghpython_script_2.NullTrigger)  # -> out, a
# ---------- ghpython_script_10: Python ----------
__author__ = "jinxinqi"
__version__ = "2022.05.06"

import rhinoscriptsyntax as rs
import scriptcontext as sc
import ghpythonlib.components as ghcomp
import Rhino
import System
import scriptcontext as sc

readFromArchive = sc.sticky[key]["readRadiusFromArchive"]

a = None
try:
    if not readFromArchive:
        a = value
        print("new value used")
    else:
        a = sc.sticky["data"][int(archiveID)-1]["radius"]
        print("archive used")
except:
    pass
    
sc.sticky[key]["readRadiusFromArchive"] = False
# ---------- end ghpython_script_10 ----------
ghpython_script_11 = GhPythonScript(
    key="windowTransition",
    value=value_listener_14.Values,
    archiveID=ghpython_script_5.holeAreaIndex,
    NullTrigger=ghpython_script_6.NullTrigger,
    NullTrigger2=ghpython_script_2.NullTrigger)  # -> out, a
# ---------- ghpython_script_11: Python ----------
__author__ = "jinxinqi"
__version__ = "2022.05.06"

import rhinoscriptsyntax as rs
import scriptcontext as sc
import ghpythonlib.components as ghcomp
import Rhino
import System
import scriptcontext as sc

readFromArchive = sc.sticky[key]["readVerticalFromArchive"]

a = None
try:
    if not readFromArchive:
        a = value
        print("new value used")
    else:
        a = sc.sticky["data"][int(archiveID)-1]["vertical"]
        print("archive used")
except:
    pass
    
sc.sticky[key]["readVerticalFromArchive"] = False
if not sc.sticky.has_key("times"):
    sc.sticky["times"] = 0
else:
    sc.sticky["times"] += 1
# ---------- end ghpython_script_11 ----------
ghpython_script_12 = GhPythonScript(
    key="windowTransition",
    value=value_listener_13.Values,
    archiveID=ghpython_script_5.holeAreaIndex,
    NullTrigger=ghpython_script_6.NullTrigger,
    NullTrigger2=ghpython_script_2.NullTrigger)  # -> out, a
# ---------- ghpython_script_12: Python ----------
__author__ = "jinxinqi"
__version__ = "2022.05.06"

import rhinoscriptsyntax as rs
import scriptcontext as sc
import ghpythonlib.components as ghcomp
import Rhino
import System
import scriptcontext as sc

readFromArchive = sc.sticky[key]["readVspaceFromArchive"]

a = None
try:
    if not readFromArchive:
        a = value
        print("new value used")
    else:
        a = sc.sticky["data"][int(archiveID)-1]["vspace"]
        print("archive used")
except:
    pass
    
sc.sticky[key]["readVspaceFromArchive"] = False
# ---------- end ghpython_script_12 ----------
ghpython_script_13 = GhPythonScript(
    key="windowTransition",
    value=value_listener_12.Values,
    archiveID=ghpython_script_5.holeAreaIndex,
    NullTrigger=ghpython_script_6.NullTrigger,
    NullTrigger2=ghpython_script_2.NullTrigger)  # -> out, a
# ---------- ghpython_script_13: Python ----------
__author__ = "jinxinqi"
__version__ = "2022.05.06"

import rhinoscriptsyntax as rs
import scriptcontext as sc
import ghpythonlib.components as ghcomp
import Rhino
import System
import scriptcontext as sc

readFromArchive = sc.sticky[key]["readHorizontalFromArchive"]

a = None
try:
    if not readFromArchive:
        a = value
        print("new value used")
    else:
        a = sc.sticky["data"][int(archiveID)-1]["horizontal"]
        print("archive used")
except:
    pass
    
sc.sticky[key]["readHorizontalFromArchive"] = False
# ---------- end ghpython_script_13 ----------
ghpython_script_14 = GhPythonScript(
    key="windowTransition",
    value=value_listener_15.Values,
    archiveID=ghpython_script_5.holeAreaIndex,
    NullTrigger=ghpython_script_6.NullTrigger,
    NullTrigger2=ghpython_script_2.NullTrigger)  # -> out, a
# ---------- ghpython_script_14: Python ----------
__author__ = "jinxinqi"
__version__ = "2022.05.06"

import rhinoscriptsyntax as rs
import scriptcontext as sc
import ghpythonlib.components as ghcomp
import Rhino
import System
import scriptcontext as sc

readFromArchive = sc.sticky[key]["readHspaceFromArchive"]

a = None
try:
    if not readFromArchive:
        a = value
        print("new value used")
    else:
        a = sc.sticky["data"][int(archiveID)-1]["hspace"]
        print("archive used")
except:
    pass
    
sc.sticky[key]["readHspaceFromArchive"] = False
# ---------- end ghpython_script_14 ----------
ghpython_script_15 = GhPythonScript(okay=value_listener_16.Values, key="holeWindow")  # -> out, radius, hspace, vspace, horizontal, vertical, innerEdge, outerEdge, referEdge
# ---------- ghpython_script_15: Python ----------
__author__ = "USER"
__version__ = "2022.05.09"

import scriptcontext as sc

if not sc.sticky.has_key(key):
    sc.sticky[key] = {}

def splitStringToFloatList(string):
    rtn = []
    for item in string.split(' '):
        try:
            _ = float(item)
            rtn.append(item)
        except:
            pass
    return rtn

print(okay)
print(key)
if okay:
    radius = sc.sticky[key]["radius"]
    print(radius)
    radius = splitStringToFloatList(radius)
    print(radius)
    hspace = sc.sticky[key]["hspace"]
    print(hspace)
    hspace = splitStringToFloatList(hspace)
    print(hspace)
    vspace = sc.sticky[key]["vspace"]
    print(vspace)
    vspace = splitStringToFloatList(vspace)
    print(vspace)
    
    horizontal = sc.sticky[key]["horizontal"]
    print(horizontal)
    vertical = sc.sticky[key]["vertical"]
    print(vertical)
    
    innerEdge = sc.sticky[key]["innerEdge"]
    print(dir(innerEdge))
    print(innerEdge)
    outerEdge = sc.sticky[key]["outerEdge"]
    print(outerEdge)
    referEdge = sc.sticky[key]["referEdge"]
    print(referEdge)
# ---------- end ghpython_script_15 ----------
create_label_6 = CreateLabel(LabelText=ghpython_script_11.a, LabelSize=12, Justification=0)
create_label_7 = CreateLabel(LabelText=ghpython_script_14.a, LabelSize=12, Justification=0)
create_label_8 = CreateLabel(LabelText=ghpython_script_10.a, LabelSize=12, Justification=0)
create_label_9 = CreateLabel(LabelText=ghpython_script_13.a, LabelSize=12, Justification=0)
create_label_10 = CreateLabel(LabelText=ghpython_script_12.a, LabelSize=12, Justification=0)
create_label_11 = CreateLabel(LabelText="Process meshes", LabelSize=12, Justification=0)
python_data_collector = GhPythonScript(key="holeWindow", innerEdge=python_2.obj_id, outerEdge=python.obj_id, referEdge=python_3.obj_id)  # -> out, a
# ---------- python_data_collector: Python ----------
__author__ = "USER"
__version__ = "2022.05.09"

import scriptcontext as sc

if not sc.sticky.has_key(key):
    sc.sticky[key] = {}

sc.sticky[key]["innerEdge"] = innerEdge
sc.sticky[key]["outerEdge"] = outerEdge
sc.sticky[key]["referEdge"] = referEdge
# ---------- end python_data_collector ----------
create_label_12 = CreateLabel(LabelText="Pick edges", LabelSize=12, Justification=0)
boolean_17 = Boolean(False)
python_data_collector_2 = GhPythonScript(
    key="holeWindow",
    radius=ghpython_script_10.a,
    hspace=ghpython_script_14.a,
    vspace=ghpython_script_12.a,
    horizontal=ghpython_script_13.a,
    vertical=ghpython_script_11.a)  # -> out, a
# ---------- python_data_collector_2: Python ----------
__author__ = "USER"
__version__ = "2022.05.09"

import scriptcontext as sc

if not sc.sticky.has_key(key):
    sc.sticky[key] = {}

sc.sticky[key]["radius"] = radius
sc.sticky[key]["hspace"] = hspace
sc.sticky[key]["vspace"] = vspace
sc.sticky[key]["horizontal"] = horizontal
sc.sticky[key]["vertical"] = vertical
# ---------- end python_data_collector_2 ----------
merge_2 = Merge(
    Data1=create_label_12,
    Data2=create_rhino_pick_button,
    Data4=create_rhino_pick_button_3,
    Data5=create_rhino_pick_button_2)
panel_8 = Panel(ghpython_script_15.outerEdge)
boolean_18 = Boolean(False)
create_label_13 = CreateLabel(LabelText="Set parameters", LabelSize=12, Justification=0)
merge_3 = Merge(
    Data1=create_label_13,
    Data2=create_text_box_2,
    Data3=create_label_8,
    Data4=create_text_box_3,
    Data5=create_label_7,
    Data6=create_text_box_5,
    Data7=create_label_10,
    Data8=create_text_box_4,
    Data9=create_label_9,
    Data10=create_text_box,
    Data11=create_label_6)
create_stack_2 = CreateStack(UIElements=merge_2, Horizontal=boolean_18)
create_border_2 = CreateBorder(UIElement=create_stack_2, BorderThickness=5, BorderColor=RGB(0, 0, 0), CornerRadius=0)
boolean_19 = Boolean(False)
create_stack_3 = CreateStack(UIElements=merge_3, Horizontal=boolean_19)
create_border_3 = CreateBorder(UIElement=create_stack_3, BorderThickness=5, BorderColor=RGB(0, 0, 0), CornerRadius=0)
create_true_only_button_6 = CreateTrueOnlyButton(ButtonName="Disable solver", ButtonStyle=0)
value_listener_17 = ValueListener(Elements=create_true_only_button_6, SomeProperty=True)  # -> Values, Indices
vb_script = VBScript(okay=value_listener_17.Values)  # -> out, A
# ---------- vb_script: VB ----------
    Dim GH As Object
    GH = RhinoApp.GetPlugInObject("Grasshopper")
    If okay Then
      '''Call GH.EnableSolver()
    '''Else
      Call GH.DisableSolver()
    End If
    GH = Nothing
# ---------- end vb_script ----------
panel_9 = Panel(vb_script.out)

curve = Curve(ghpython_script_15.referEdge)
curve_2 = Curve(ghpython_script_15.outerEdge)
curve_3 = Curve(ghpython_script_15.innerEdge)
horizontal = Number(ghpython_script_15.horizontal)
vertical = Number(ghpython_script_15.vertical)
python_4 = GhPythonScript(horizontal=horizontal, vertical=vertical)  # -> out, uvfactor
# ---------- python_4: Python ----------
__author__ = "DELL"
__version__ = "2022.05.07"

import rhinoscriptsyntax as rs
import math

uvfactor = vertical/((horizontal/2)*math.sqrt(3))
# ---------- end python_4 ----------
division = Division(A=1, B=python_4.uvfactor)

cluster = Cluster(referedge=curve, radius=ghpython_script_15.radius, vspace=ghpython_script_15.vspace, hspace=ghpython_script_15.hspace)
data = Data(cluster)
lng = ListLength(List=data)
subtraction = Subtraction(A=lng, B=1)
item = ListItem(List=data, Index=0, Wrap=True)
item_2 = ListItem(List=data, Index=subtraction, Wrap=True)
D = Dict(item_2)

cluster_2 = Cluster_8(outercrv=curve_2, innercrv=curve_3)  # -> outercrv_2, innercrv_2
len = Length(Curve=curve)

cluster_3 = Cluster_2(crv=cluster_2.innercrv_2, rowconf=item)  # -> pts, vec_2, radius, refer_pts, refer_vec, bottom_border
cluster_4 = Cluster_3(crv=cluster_2.outercrv_2, refer_pts=cluster_3.refer_pts, refer_vec=cluster_3.refer_vec, refer_dis=len, D=D)  # -> top_subcrv, refer_pts_2
display = Display(pts=cluster_3.pts, radius=cluster_3.radius)
pt = Point(cluster_3.pts)
pt_2 = Point(cluster_3.refer_pts)
cluster_5 = Cluster_4(refer_pts=cluster_4.refer_pts_2, crv=cluster_2.outercrv_2, refer_dis=len, D=D, top_subcrv=cluster_4.top_subcrv)  # -> pts, offset_curve, radius, top_border
python_5 = GhPythonScript(
    inner_refer_pts=cluster_3.refer_pts,
    outer_refer_pts=cluster_4.refer_pts_2,
    row_confs=cluster,
    inner_crv=cluster_2.innercrv_2,
    outer_crv=cluster_2.outercrv_2,
    refer_dis=len,
    top_border=cluster_5.top_border,
    bottom_border=cluster_3.bottom_border)  # -> out, inside_refer_pts, inside_radius, top_border_updated, bottom_border_updated; inputs inner_refer_pts: list of Point3d, outer_refer_pts: list of Point3d, row_confs: list, inner_crv: Curve, outer_crv: Curve, top_border: Curve, bottom_border: Curve, top_row_num: Int32, bottom_row_num: Int32, ref_border: Curve
# ---------- python_5: Python ----------
__author__ = "wangxu"
__version__ = "2022.05.06"

import rhinoscriptsyntax as rs
import ghpythonlib.components as ghcomp

row_num = ghcomp.ListLength(row_confs)
print(row_num)

#print(row_confs)
#print(row_num)
inside_row_num = row_num - 2
bottom_inside_row_num = int((inside_row_num + 1) / 2)
#print(bottom_inside_row_num)
top_inside_row_num = inside_row_num - bottom_inside_row_num

inside_refer_pts = []
inside_radius = []

for i in range(bottom_inside_row_num):
    current_row_conf = ghcomp.ListItem(row_confs, i + 1, True)
    _, current_offset, _ = ghcomp.Dhictionary.DictSelect([current_row_conf], 'offset')
    _, current_radius, _ = ghcomp.Dhictionary.DictSelect([current_row_conf], 'radius')
    #print(current_radius)
    current_crv = ghcomp.OffsetCurve(inner_crv, current_offset)
    bottom_border = ghcomp.OffsetCurve(current_crv, current_radius)
    P, t, D = ghcomp.CurveClosestPoint(inner_refer_pts, current_crv)
    if i % 2 == 0:
        # mapping to inner line
        #print(ghcomp.ListLength(P))
        P1 = ghcomp.CullIndex(P, ghcomp.ListLength(P) - 1)
        #print(ghcomp.ListLength(P1))
        P2 = ghcomp.CullIndex(P, 0)
        P3 = ghcomp.Addition(P1, P2)
        P4 = ghcomp.Division(P3, 2)
        #print(ghcomp.ListLength(P4))
        P5, _, _ = ghcomp.CurveClosestPoint(P4, current_crv)
        inside_refer_pts += P5
        for j in range(len(P5)):
            inside_radius.append(current_radius)

    else:
        # mapping to outer line
        inside_refer_pts += P
        for j in range(len(P)):
            inside_radius.append(current_radius)

for i in range(bottom_inside_row_num, inside_row_num):
    next_row_conf = ghcomp.ListItem(row_confs, i+2, True)
    current_row_conf = ghcomp.ListItem(row_confs, i+1, True)
    _, current_offset, _ = ghcomp.Dhictionary.DictSelect([current_row_conf], 'offset')
    _, current_radius, _ = ghcomp.Dhictionary.DictSelect([current_row_conf], 'radius')
    #print(current_radius)
    _, current_vspace, _ = ghcomp.Dhictionary.DictSelect([current_row_conf], 'vspace')
    _, next_vspace, _ = ghcomp.Dhictionary.DictSelect([next_row_conf], 'vspace')
    crv_offset = refer_dis - current_offset
    current_crv = ghcomp.OffsetCurve(outer_crv, -crv_offset)
    P, t, D = ghcomp.CurveClosestPoint(outer_refer_pts, current_crv)
    print(i, current_vspace)
    top_border = ghcomp.OffsetCurve(top_border, -next_vspace)
    
    if i % 2 == 0:
        # mapping to inner line
        #print('here')
        #print(ghcomp.ListLength(P))
        P1 = ghcomp.CullIndex(P, ghcomp.ListLength(P) - 1)
        #print(ghcomp.ListLength(P1))
        P2 = ghcomp.CullIndex(P, 0)
        P3 = ghcomp.Addition(P1, P2)
        P4 = ghcomp.Division(P3, 2)
        #print(ghcomp.ListLength(P4))
        P5, _, _ = ghcomp.CurveClosestPoint(P4, current_crv)
        inside_refer_pts += P5
        inside_radius.append(current_radius)
    else:
        # mapping to outer line
        inside_refer_pts += P
        inside_radius.append(current_radius)

top_border_updated = top_border
bottom_border_updated = bottom_border
print("finish")
# ---------- end python_5 ----------
crv = Curve(cluster_4.top_subcrv)
pt_3 = Point(cluster_4.refer_pts_2)
crv_2 = Curve(cluster_3.bottom_border)
shifthalf = Shifthalf(P=cluster_5.pts, crv=cluster_5.offset_curve)
pt_4 = Point(cluster_5.pts)
crv_3 = Curve(cluster_5.offset_curve)
crv_4 = Curve(cluster_5.top_border)
crv_5 = Curve(python_5.bottom_border_updated)
pt_5 = Point(python_5.inside_refer_pts)
display_2 = Display(pts=pt_5, radius=python_5.inside_radius)
crv_6 = Curve(python_5.top_border_updated)
python_6 = GhPythonScript(aligned_pts=cluster_5.pts, shifted_pts=shifthalf, row_confs=cluster)  # -> out, outer_pts; inputs aligned_pts: list of Point3d, shifted_pts: list of Point3d, row_confs: list
# ---------- python_6: Python ----------
__author__ = "zhengyawen"
__version__ = "2022.05.07"

import rhinoscriptsyntax as rs
import ghpythonlib.components as ghcomp

row_num = ghcomp.ListLength(row_confs)
print(row_num)

outer_pts = []
if(row_num % 2 == 0):
    outer_pts = shifted_pts
else:
    outer_pts = aligned_pts
    
print("finish")
# ---------- end python_6 ----------
srf = Surface(display_2)
display_3 = Display(pts=python_6.outer_pts, radius=cluster_5.radius)

cp = ControlPoints(Curve=crv_6)  # -> Points, Weights, Knots
crv_cp = CurveClosestPoint(Point=cp.Points, Curve=crv_5)  # -> Point, Parameter, Distance
item_3 = ListItem(List=crv_cp.Parameter, Index=0, Wrap=True)
lng_2 = ListLength(List=crv_cp.Parameter)
subtraction_2 = Subtraction(A=lng_2, B=1)
item_4 = ListItem(List=crv_cp.Parameter, Index=subtraction_2, Wrap=True)
dom = ConstructDomain(DomainStart=item_3, DomainEnd=item_4)
subcrv = SubCurve(BaseCurve=crv_5, Domain=dom)
crv_7 = Curve(subcrv)

ccx = CurveCurve(CurveA=crv_6, CurveB=crv_7)  # -> Points, ParamsA, ParamsB
cluster_6 = Cluster_7(crv1=crv_6, crv2=crv_7, t1=ccx.ParamsA, t2=ccx.ParamsB)
srf_2 = Surface(cluster_6)

edges = BrepEdges(Brep=cluster_6)  # -> Naked, Interior, NonManifold
offset = OffsetCurve(Curve=cluster_6, Distance=-1.275, Corners=num)
join = JoinCurves(Curves=edges.Naked, Preserve=False)
divide = DivideCurve(Curve=offset, Count=10, Kinks=False)  # -> Points, Tangents, Parameters
crv_8 = Curve(offset)
pline = PolyLine(Vertices=divide.Points, Closed=False)
pcen = PolygonCenter(Polyline=pline)  # -> CenterV, CenterE, CenterA
scale_nu = ScaleNU(Geometry=offset, Plane=pcen.CenterV, ScaleX=1, ScaleY=python_4.uvfactor, ScaleZ=1)  # -> Geometry, Transform
srf_3 = Surface(scale_nu.Geometry)
edges_2 = BrepEdges(Brep=srf_3)  # -> Naked, Interior, NonManifold
join_2 = JoinCurves(Curves=edges_2.Naked, Preserve=False)
crv_9 = Curve(join_2)
meshref = MeshRef(crv=crv_9, horizontal=horizontal, vertical=horizontal, surround=horizontal)  # -> mesh_2, vernum_2, upleftbasept_2, direction_2
crv_10 = Curve(offset)
mesh_2 = Mesh(meshref.mesh_2)
medges = MeshEdges(Mesh=mesh_2)  # -> NakedEdges, InteriorEdges, NonManifoldEdges

scale_nu_2 = ScaleNU(Geometry=mesh, Plane=pcen.CenterV, ScaleX=1, ScaleY=division, ScaleZ=1)  # -> Geometry, Transform
mesh_3 = Mesh(scale_nu_2.Geometry)
cluster_7 = Cluster_5(mesh=mesh_3, crv=crv_10)  # -> line_6, line_5
demesh = DeconstructMesh(Mesh=mesh_3)  # -> Vertices, Faces, Colours, Normals
medges_2 = MeshEdges(Mesh=scale_nu_2.Geometry)  # -> NakedEdges, InteriorEdges, NonManifoldEdges
pt_6 = Point(demesh.Vertices)
display_4 = Display(pts=demesh.Vertices, radius=0.8)
line = Line(cluster_7.line_5)
line_2 = Line(cluster_7.line_6)
num_2 = Number(meshref.vernum_2)
srf_4 = Surface(display_4)

create_3d_view = Create3DView(MeshToDisplay=mesh_2, MeshColors=RGB(255, 0, 0), ViewWidth=300, ViewHeight=300)
ghpython_script_16 = GhPythonScript(
    mainWindowKey="mainWindow",
    holeWindowKey="holeWindow",
    dataKey="data",
    metadataKey="metadata",
    okay=ghpython_script_8.okay,
    instant_meshes_path="D:\\Documents\\Project\\yinhua\\0525\\InstantMeshes.exe",
    num=num_2,
    jsonPath="D:\\Documents\\Project\\yinhua\\0525\\json.txt")  # -> out, returnValue, editList, BlockName
# ---------- ghpython_script_16: Python ----------
__author__ = "USER"
__version__ = "2022.05.07"

import rhinoscriptsyntax as rs
import scriptcontext as sc
import os
import json
import Rhino
        
if okay and sc.sticky[holeWindowKey]["open_instant_meshes"]:
    try:
        # We call instant meshes
        #s = "".join(os.popen("{} -o C:\\Users\\USER\\Desktop\\mesh_a.ply -r 6 -p 6 -t 8 -d -D -v {} -b C:\\Users\\USER\\Desktop\\mesh.ply".format(instant_meshes_path, int(num))).readlines())
        returnValue = os.system("{} -o D:\\Documents\\Project\\yinhua\\0525\\mesh_a.ply -r 6 -p 6 -t 8 -d -D -v {} -b D:\\Documents\\Project\\yinhua\\0525\\mesh.ply".format(instant_meshes_path, int(num)))
        if returnValue==0:
            # We import the generated meshes
            print(sc.sticky)
            print("HoleBlock{}".format(sc.sticky[mainWindowKey]["holeAreaIndex"]))
            sc.doc = Rhino.RhinoDoc.ActiveDoc
            BlockName = "HoleBlock{}".format(sc.sticky[mainWindowKey]["holeAreaIndex"])
            print(BlockName)
            for obj in sc.doc.Objects:
                sc.doc.Objects.Find(obj.Id).Select(False)
            print(type(rs.ObjectsByName(BlockName)))
            for obj in rs.ObjectsByName(BlockName):
                print(obj)
                sc.doc.Objects.Find(obj).Select(True)
                rs.Command("!_-Delete _EnterEnd")
            sc.doc = ghdoc
            rs.Command("!_-Import D:\\Documents\\Project\\yinhua\\0525\\mesh_a.ply _EnterEnd")
            #BlockName = "HoleBlock{}".format(1 if not (sc.sticky.has_key(metadataKey) and isinstance(sc.sticky[metadataKey], int)) else sc.sticky[metadataKey] + 1)
            rs.Command("!_-SetObjectName {} _EnterEnd".format(BlockName))
            
            # We update editList and some global data
            editList = []
            dataItem = {"radius": sc.sticky[holeWindowKey]["radius"], "hspace": sc.sticky[holeWindowKey]["hspace"], "vspace": sc.sticky[holeWindowKey]["vspace"], "horizontal": sc.sticky[holeWindowKey]["horizontal"], "vertical": sc.sticky[holeWindowKey]["vertical"], \
                "innerEdge": sc.sticky[holeWindowKey]["innerEdge"], "outerEdge": sc.sticky[holeWindowKey]["outerEdge"], "referEdge": sc.sticky[holeWindowKey]["referEdge"]}
            print(dataItem)
            if not (sc.sticky.has_key(dataKey) and isinstance(sc.sticky[dataKey], list)):
                sc.sticky[dataKey]=[dataItem]
            else:
                sc.sticky[dataKey].append(dataItem)
            data = json.dumps(sc.sticky[dataKey])
            
            if not (sc.sticky.has_key(metadataKey) and isinstance(sc.sticky[metadataKey], int)):
                sc.sticky[metadataKey] = 1
            else:
                sc.sticky[metadataKey] += 1
            metadata = json.dumps(sc.sticky[metadataKey])
            
            print(sc.sticky[metadataKey]+1)
            for i in range(1,sc.sticky[metadataKey]+1):
                editList.append(i)
            
            with open(jsonPath, "a") as f:
                f.write("DATA\n"+data+"\n")
                f.write("METADATA\n"+metadata+"\n")
    except:
        pass
    sc.sticky[holeWindowKey]["open_instant_meshes"] = False
# ---------- end ghpython_script_16 ----------
ghpython_script_17 = GhPythonScript(holeWindowKey="holeWindow", okay=ghpython_script_9.okay, block=mesh_2)  # -> out, rhino_obj
# ---------- ghpython_script_17: Python ----------
__author__ = "USER"
__version__ = "2022.05.07"

import rhinoscriptsyntax as rs
import scriptcontext
import Rhino

def MeshOptions(a,b,c,d,e,f,g,h,i,j,k):
    mo="_DetailedOptions _JaggedSeams={} _PackTextures={} ".format(a,b)
    mo+="_Refine={} _SimplePlane={} _AdvancedOptions _Angle={} ".format(c,d,e)
    mo+="_AspectRatio={} _Distance={} _Density={} _Grid={} ".format(f,g,h,i)
    mo+="_MaxEdgeLength={} _MinEdgeLength={} _Enter _Enter".format(j,k)
    return mo

if okay and scriptcontext.sticky[holeWindowKey]["generate_save_meshes"]:
    try:
        print(type(block))     #debug message to Python output
        
        #we obtain the reference in the Rhino doc
        doc_object = ghdoc.Objects.Find(block)
        print(type(doc_object))
        
        attributes = doc_object.Attributes
        print('the type of attributes is: ' + str(type(attributes)))     #debug message to Python output
    
        geometry = doc_object.Geometry
        print('the type of geometry is: ' + str(type(doc_object)))     #debug message to Python output
    
        #we change the scriptcontext
        scriptcontext.doc = Rhino.RhinoDoc.ActiveDoc
        
        #we add both the geometry and the attributes to the Rhino doc
        rhino_obj = scriptcontext.doc.Objects.Add(geometry, attributes)
        print('the Rhino doc ID is: ' + str(rhino_obj))     #debug message to Python output
    
        #we select the object generated via baking
        rhino_objs = scriptcontext.doc.Objects
        for obj in rhino_objs:
            scriptcontext.doc.Objects.Find(obj.Id).Select(False)
        print(scriptcontext.doc.Objects.Find(rhino_obj).Id)
        scriptcontext.doc.Objects.Find(rhino_obj).Select(True)
        
        #we convert the object to a mesh
        #rs.Command("!_-Mesh "+MeshOptions("No","Yes","Yes","Yes",0,0,0.01,0,0,0,0))
        
        #we export the mesh
        rs.Command("!_-ExportWithOrigin 0,0,0 D:\\Documents\\Project\\yinhua\\0525\\mesh.ply _EnterEnd")
        
        #we call instant-meshes
        #os.system(instant-meshes-path)
        
    except:
        pass
        
    scriptcontext.sticky[holeWindowKey]["generate_save_meshes"] = False
    
    #we put back the original Grasshopper document as default
    scriptcontext.doc = ghdoc
# ---------- end ghpython_script_17 ----------
panel_10 = Panel(ghpython_script_17.out)
panel_11 = Panel(ghpython_script_16.out)
merge_4 = Merge(Data1=create_label_11, Data2=create_true_only_button_3, Data3=create_3d_view, Data4=create_true_only_button_4)
create_stack_4 = CreateStack(UIElements=merge_4, Horizontal=boolean_17)
create_border_4 = CreateBorder(UIElement=create_stack_4, BorderThickness=5, BorderColor=RGB(0, 0, 0), CornerRadius=0)
merge_5 = Merge(Data1=create_border_2, Data2=create_border_3, Data3=create_true_only_button_5, Data4=create_border_4)
add_elements = AddElements(Window=launch_window_2, Elements=flatten(merge_5), DoVLChecking=True)  # -> AddedElements, ElementNames

create_list_box = CreateListBox(ListItems=ghpython_script_16.editList, SelectedIndex=0, Height=100)
value_listener_18 = ValueListener(Elements=create_list_box, SomeProperty=True)  # -> Values, Indices
ghpython_script_18 = GhPythonScript(index=value_listener_18.Values, key="mainWindow")  # -> out, a
# ---------- ghpython_script_18: Python ----------
__author__ = "USER"
__version__ = "2022.05.22"

import rhinoscriptsyntax as rs
import scriptcontext as sc

if index is not None:
    if not sc.sticky.has_key(key):
        sc.sticky[key] = {}
    sc.sticky[key]["holeAreaIndexCandidate"] = index
# ---------- end ghpython_script_18 ----------
merge_6 = Merge(Data1=create_label_2, Data2=create_label, Data3=create_list_box, Data4=create_true_only_button_2)
create_stack_5 = CreateStack(UIElements=merge_6, Horizontal=boolean_5)
create_border_5 = CreateBorder(UIElement=create_stack_5, BorderThickness=5, BorderColor=RGB(0, 0, 0), CornerRadius=0)
merge_7 = Merge(Data1=create_label_5, Data2=create_border, Data3=create_label_4, Data4=create_border_5)
add_elements_2 = AddElements(Window=launch_window, Elements=flatten(merge_7), DoVLChecking=True)  # -> AddedElements, ElementNames

panel_12 = Panel(ghpython_script_16.BlockName)
refname = ReferenceByName(ObjectName=panel_12, lightweight=False)

# ==== cluster Cluster
referedge = ClusterInput()
radius = ClusterInput()
vspace = ClusterInput()
hspace = ClusterInput()
panel = Panel(vspace)
panel_2 = Panel(radius)
num = Number(radius)
num_2 = Number(hspace)
crv = Curve(referedge)
num_3 = Number(vspace)
python = GhPythonScript(crv=crv, radius=num, vspace=num_3, hspace=num_2)  # -> out, row_confs; inputs crv: Curve, radius: list, vspace: list, hspace: list
# ---------- python: Python ----------
__author__ = "wangxu"
__version__ = "2022.05.06"

import rhinoscriptsyntax as rs
import ghpythonlib.components as ghcomp

def safe_list_access(arr, i):
    arr_len = len(arr)
    if i < 0:
        return 0
    elif i < arr_len:
        return arr[i]
    else:
        return arr[arr_len - 1]

crv_length = crv.GetLength()
print(crv_length)
i = 0
total_offset = 0.0

row_confs = []

n = len(radius)
while True:
    cr = safe_list_access(radius, i)
    cv = safe_list_access(vspace, i - 1)
    print(cv)
    offset = cv
    if cv == 0:
        offset = cr
    total_offset += offset
    item = ghcomp.Dhictionary.CreateDictionary(['offset', 'radius', 'vspace', 'hspace'], [total_offset, cr, cv, hspace[0]])
    row_confs.append(item)
  
    if ((total_offset >= crv_length) or (i == n - 1)):
        break
    else:
        i += 1
print(row_confs)
# ---------- end python ----------
D = Dict(python.row_confs)
row_conf = ClusterOutput(D)

# ==== cluster Cluster_2
rowconf = ClusterInput()
crv = ClusterInput()  # 内环曲线
dictselect = DictSelect(Dict=rowconf, Key="hspace")  # -> Key, Value, Found
dictselect_2 = DictSelect(Dict=rowconf, Key="radius")  # -> Key, Value, Found
dictselect_3 = DictSelect(Dict=rowconf, Key="offset")  # -> Key, Value, Found

# ---- group: 内环1 / 参数
crv_2 = Curve(crv)
num = Number(dictselect.Value)
num_2 = Number(dictselect_2.Value)

# ----
offset = OffsetCurve(Curve=crv_2, Distance=dictselect_3.Value, Corners=1)

# ---- group: 内环1
len = Length(Curve=crv_2)
division = Division(A=len, B=num)
round = Round(Number=division)  # -> Nearest, Floor, Ceiling
divide = DivideCurve(Curve=offset, Count=round.Floor, Kinks=False)  # -> Points, Tangents, Parameters

# ----
offset_2 = OffsetCurve(Curve=offset, Distance=dictselect_2.Value, Corners=1)
crv_cp = CurveClosestPoint(Point=divide.Points, Curve=crv_2)  # -> Point, Parameter, Distance

# ---- group: 内环1 / 输出
pt = Point(divide.Points)
vec = Vector(divide.Tangents)

# ----
eval = EvaluateCurve(Curve=crv_2, Parameter=crv_cp.Parameter)  # -> Point, Tangent, Angle
bottom_border = ClusterOutput(offset_2)
refer_vec = ClusterOutput(eval.Tangent)
refer_pts = ClusterOutput(crv_cp.Point)
radius = ClusterOutput(num_2)
pts = ClusterOutput(pt)  # 圆点坐标
vec_2 = ClusterOutput(vec)  # 切线方向

# ==== cluster Display
radius = ClusterInput()
pts = ClusterInput()
cir = Circle(Plane=pts, Radius=radius)
srf = Surface(cir)
srf_2 = ClusterOutput(srf)

# ==== cluster Cluster_3
refer_dis = ClusterInput()
D = ClusterInput()
refer_pts = ClusterInput()
refer_vec = ClusterInput()
crv = ClusterInput()
crv_2 = Curve(crv)
pt = Point(refer_pts)
crv_cp = CurveClosestPoint(Point=refer_pts, Curve=crv)  # -> Point, Parameter, Distance
multiplication = Multiplication(A=refer_dis, B=1.1)
eval = EvaluateCurve(Curve=crv, Parameter=crv_cp.Parameter)  # -> Point, Tangent, Angle
multiplication_2 = Multiplication(A=refer_vec, B=eval.Tangent)
abs = Absolute(Value=multiplication_2)
D_2 = Dict(D)
acos = ArcCosine(Value=abs)
pi = Pi(Factor=1)
division = Division(A=acos, B=pi)
multiplication_3 = Multiplication(A=division, B=180)
dictselect = DictSelect(Dict=D_2, Key="hspace")  # -> Key, Value, Found
smaller = SmallerThan(FirstNumber=multiplication_3, SecondNumber=10)  # -> SmallerThan, OrEqualTo
smaller_2 = SmallerThan(FirstNumber=crv_cp.Distance, SecondNumber=multiplication)  # -> SmallerThan, OrEqualTo
num = Number(crv_cp.Parameter)
and = GateAnd(A=smaller.SmallerThan, B=smaller_2.SmallerThan)
shift = ShiftList(List=and, Shift=1, Wrap=True)
xor = GateXor(A=and, B=shift)
bool = Boolean(True)
mindex = MemberIndex(Set=xor, Member=bool)  # -> Index, Count
item = ListItem(List=crv_cp.Point, Index=mindex.Index, Wrap=True)
pt_2 = Point(item)
item_2 = ListItem(List=mindex.Index, Index=1, Wrap=True)
item_3 = ListItem(List=mindex.Index, Index=0, Wrap=True)
item_4 = ListItem(List=num, Index=mindex.Index, Wrap=True)
dom = ConstructDomain(DomainStart=item_3, DomainEnd=item_2)
subtraction = Subtraction(A=item_2, B=item_3)
pt_3 = Point(crv_cp.Point)
bnd = Bounds(Numbers=item_4)
item_5 = ListItem(List=mindex.Index, Index=0, Wrap=True)
range = Range(Domain=dom, Steps=subtraction)
bool_2 = Boolean(False)
cull_i = CullIndex(List=range, Indices=0, Wrap=True)
replace = ReplaceItems(List=and, Item=bool_2, Indices=cull_i, Wrap=False)
subcrv = SubCurve(BaseCurve=crv, Domain=bnd)
crv_3 = Curve(subcrv)
len = Length(Curve=subcrv)
division_2 = Division(A=len, B=dictselect.Value)
top_subcrv = ClusterOutput(subcrv)
round = Round(Number=division_2)  # -> Nearest, Floor, Ceiling
divide = DivideCurve(Curve=subcrv, Count=round.Floor, Kinks=False)  # -> Points, Tangents, Parameters
pt_4 = Point(divide.Points)
lng = ListLength(List=pt_4)
subtraction_2 = Subtraction(A=lng, B=1)
cull_i_2 = CullIndex(List=pt_4, Indices=subtraction_2, Wrap=True)
cull_i_3 = CullIndex(List=pt_4, Indices=0, Wrap=True)  # -> reverse(List)
dispatch = Dispatch(List=pt_3, DispatchPattern=replace)  # -> ListA, ListB
lng_2 = ListLength(List=cull_i_3)
rev = ReverseList(List=cull_i_3)
pt_5 = Point(dispatch.ListB)
python = GhPythonScript(start=item_3, count=lng_2)  # -> out, index_list, after_list; inputs start: Int32
# ---------- python: Python ----------
__author__ = "zhengyawen"
__version__ = "2022.05.07"

import rhinoscriptsyntax as rs
import ghpythonlib.components as ghcomp

index_list = []
after_list = []
i = 0

while(i<count):
    index_list.append(start+1)
    after_list.append(start+i+1)
    i += 1
# ---------- end python ----------
ins = InsertItems(List=dispatch.ListA, Item=rev, Indices=python.index_list, Wrap=True)
pt_6 = Point(ins)
refer_pts_2 = ClusterOutput(pt_6)

# ==== cluster Cluster_4
D = ClusterInput()
top_subcrv = ClusterInput()
refer_dis = ClusterInput()
crv = ClusterInput()
refer_pts = ClusterInput()
dictselect = DictSelect(Dict=D, Key="offset")  # -> Key, Value, Found
dictselect_2 = DictSelect(Dict=D, Key="radius")  # -> Key, Value, Found
subtraction = Subtraction(A=dictselect.Value, B=refer_dis)
offset = OffsetCurve(Curve=top_subcrv, Distance=subtraction, Corners=1)
offset_2 = OffsetCurve(Curve=crv, Distance=subtraction, Corners=1)
num = Number(dictselect_2.Value)
multiplication = Multiplication(A=num, B=-1)
crv_cp = CurveClosestPoint(Point=refer_pts, Curve=offset_2)  # -> Point, Parameter, Distance
offset_3 = OffsetCurve(Curve=offset, Distance=multiplication, Corners=1)
pt = Point(crv_cp.Point)
top_border = ClusterOutput(offset_3)
pts = ClusterOutput(pt)
offset_curve = ClusterOutput(offset_2)
radius = ClusterOutput(num)

# ==== cluster Cluster_5
mesh = ClusterInput()
crv = ClusterInput()
mesh_2 = Mesh(mesh)
crv_2 = Curve(crv)
medges = MeshEdges(Mesh=mesh_2)  # -> NakedEdges, InteriorEdges, NonManifoldEdges
medges_2 = MeshEdges(Mesh=mesh_2)  # -> NakedEdges, InteriorEdges, NonManifoldEdges
line = Line(medges_2.InteriorEdges)
midpt = CurveMiddle(Curve=line)
incurve = PointInCurve(Point=midpt, Curve=crv_2)  # -> Relationship, Point
equals = Equality(FirstNumber=incurve.Relationship, SecondNumber=2)  # -> Equality, Inequality
dispatch = Dispatch(List=line, DispatchPattern=equals.Equality)  # -> ListA, ListB
crv_3 = Curve(crv_2)
line_2 = Line(dispatch.ListA)
cp = ControlPoints(Curve=line_2)  # -> Points, Weights, Knots
item = ListItem(List=cp.Points, Index=1, Wrap=True)  # -> flatten(Item)
item_2 = ListItem(List=cp.Points, Index=0, Wrap=True)  # -> flatten(Item)
incurve_2 = PointInCurve(Point=item_2, Curve=crv_3)  # -> Relationship, Point
incurve_3 = PointInCurve(Point=item, Curve=crv_3)  # -> Relationship, Point
equals_2 = Equality(FirstNumber=incurve_2.Relationship, SecondNumber=1)  # -> Equality, Inequality
equals_3 = Equality(FirstNumber=incurve_3.Relationship, SecondNumber=1)  # -> Equality, Inequality
xor = GateXor(A=equals_2.Equality, B=equals_3.Equality)
dispatch_2 = Dispatch(List=line_2, DispatchPattern=xor)  # -> ListA, ListB
line_3 = Line(dispatch_2.ListB)
line_4 = Line(dispatch_2.ListA)
line_5 = ClusterOutput(line_3)
line_6 = ClusterOutput(line_4)

# ==== cluster MeshRef: create input variables for instant meshes exe
surround = ClusterInput()
vertical = ClusterInput()
horizontal = ClusterInput()
crv = ClusterInput()

surround_2 = Number(surround)
crv_2 = Curve(crv)
horizontal_2 = Number(horizontal)
vertical_2 = Number(vertical)

addition = Addition(A=horizontal_2, B=vertical_2)
multiplication = Multiplication(A=horizontal_2, B=vertical_2)
disc = Discontinuity(Curve=crv_2, Level=1)  # -> Points, Parameters
offset = OffsetCurve(Curve=crv_2, Distance=addition, Plane=PlaneXY(0, 0, 0), Corners=1)
pdecon = Deconstruct(Point=disc.Points)  # -> XComponent, YComponent, ZComponent
len = Length(Curve=crv_2)
division = Division(A=len, B=surround_2)
area = Area(Geometry=crv_2)  # -> Area, Centroid
division_2 = Division(A=area.Area, B=multiplication)
srf = Surface(offset)
round = Round(Number=division)  # -> Nearest, Floor, Ceiling
divide = DivideCurve(Curve=crv_2, Count=round.Nearest, Kinks=False)  # -> Points, Tangents, Parameters
merge = Merge(Data1=disc.Points, Data2=divide.Points)
divide_2 = DivideCurve(Curve=crv_2, Count=round.Nearest, Kinks=False)  # -> Points, Tangents, Parameters
pt = Point(divide.Points)
pdecon_2 = Deconstruct(Point=merge)  # -> XComponent, YComponent, ZComponent
bnd = Bounds(Numbers=pdecon.XComponent)
dedomain = DeconstructDomain(Domain=bnd)  # -> Start, End
larger = LargerThan(FirstNumber=pdecon.XComponent, SecondNumber=dedomain.Start)  # -> LargerThan, OrEqualTo
dispatch = Dispatch(List=disc.Points, DispatchPattern=larger.LargerThan)  # -> ListA, ListB
pdecon_3 = Deconstruct(Point=divide_2.Points)  # -> XComponent, YComponent, ZComponent
pt_2 = Point(divide_2.Points)
bnd_2 = Bounds(Numbers=pdecon_2.XComponent)
dedomain_2 = DeconstructDomain(Domain=bnd_2)  # -> Start, End
bnd_3 = Bounds(Numbers=pdecon_2.YComponent)
dedomain_3 = DeconstructDomain(Domain=bnd_3)  # -> Start, End
bnd_4 = Bounds(Numbers=pdecon_3.XComponent)
dedomain_4 = DeconstructDomain(Domain=bnd_4)  # -> Start, End
subtraction = Subtraction(A=dedomain_4.End, B=dedomain_4.Start)
bnd_5 = Bounds(Numbers=pdecon_3.YComponent)
dedomain_5 = DeconstructDomain(Domain=bnd_5)  # -> Start, End
subtraction_2 = Subtraction(A=dedomain_5.End, B=dedomain_5.Start)
pt_3 = ConstructPoint(XCoordinate=dedomain_2.Start, YCoordinate=dedomain_3.End, ZCoordinate=0)
division_3 = Division(A=subtraction, B=horizontal_2)
division_4 = Division(A=subtraction_2, B=vertical_2)
pt_4 = Point(pt_3)
round_2 = Round(Number=division_4)  # -> Nearest, Floor, Ceiling
round_3 = Round(Number=division_3)  # -> Nearest, Floor, Ceiling
addition_2 = Addition(A=round_2.Nearest, B=1)
addition_3 = Addition(A=round_3.Nearest, B=1)
pdecon_4 = Deconstruct(Point=pt_3)  # -> XComponent, YComponent, ZComponent
dom = ConstructDomain(DomainStart=0, DomainEnd=round_3.Nearest)
dom_2 = ConstructDomain(DomainStart=0, DomainEnd=round_2.Nearest)
multiplication_2 = Multiplication(A=addition_2, B=addition_3)
range = Range(Domain=dom, Steps=round_3.Nearest)
range_2 = Range(Domain=dom_2, Steps=round_2.Nearest)
lng = ListLength(List=range_2)
repeat = RepeatData(Data=range, Length=multiplication_2)
repeat_2 = RepeatData(Data=range_2, Length=multiplication_2)
multiplication_3 = Multiplication(A=range_2, B=vertical_2)
multiplication_4 = Multiplication(A=lng, B=2)
multiplication_5 = Multiplication(A=repeat, B=horizontal_2)
matrix = ConstructMatrix(Rows=addition_2, Columns=addition_3, Values=multiplication_5)
transpose = TransposeMatrix(Matrix=matrix)
dematrix = DeconstructMatrix(Matrix=transpose)  # -> Rows, Columns, Values
multiplication_6 = Multiplication(A=repeat_2, B=vertical_2)
repeat_3 = RepeatData(Data=multiplication_3, Length=multiplication_4)
addition_4 = Addition(A=pdecon_4.XComponent, B=dematrix.Values)
subtraction_3 = Subtraction(A=pdecon_4.YComponent, B=multiplication_6)
merge_2 = Merge(Data1=dedomain_4.Start, Data2=dedomain_4.End)
matrix_2 = ConstructMatrix(Rows=2, Columns=lng, Values=repeat_3)
pt_5 = ConstructPoint(XCoordinate=addition_4, YCoordinate=subtraction_3, ZCoordinate=0)
repeat_4 = RepeatData(Data=merge_2, Length=multiplication_4)
transpose_2 = TransposeMatrix(Matrix=matrix_2)
pt_6 = Point(pt_5)
incurve = PointInCurve(Point=pt_6, Curve=crv_2)  # -> Relationship, Point
dematrix_2 = DeconstructMatrix(Matrix=transpose_2)  # -> Rows, Columns, Values
subtraction_4 = Subtraction(A=pdecon_4.YComponent, B=dematrix_2.Values)
dispatch_2 = Dispatch(List=pt_6, DispatchPattern=incurve.Relationship)  # -> ListA, ListB
pt_7 = ConstructPoint(XCoordinate=repeat_4, YCoordinate=subtraction_4, ZCoordinate=0)
merge_3 = Merge(Data1=dispatch_2.ListA, Data2=divide.Points)  # -> flatten(Result)
pt_8 = Point(dispatch_2.ListA)
dispatch_3 = Dispatch(List=pt_7, DispatchPattern=[True, False])  # -> ListA, ListB
pt_9 = Point(pt_7)
lng_2 = ListLength(List=merge_3)
pt_10 = Point(merge_3)
sort_pt = SortPoints(Points=dispatch_3.ListB)  # -> Points, Indices
sort_pt_2 = SortPoints(Points=dispatch_3.ListA)  # -> Points, Indices
pt_11 = Point(dispatch_3.ListB)
pt_12 = Point(dispatch_3.ListA)
graft = GraftTree(Tree=sort_pt.Points, IncludeEmptyLists=True, IncludeNullItems=True)
graft_2 = GraftTree(Tree=sort_pt_2.Points, IncludeEmptyLists=True, IncludeNullItems=True)
srf_2 = Surface(crv_2)
merge_4 = Merge(Data1=graft_2, Data2=graft)
tri = Triangulate(Mesh=srf_2)  # -> Mesh, Count
pline = PolyLine(Vertices=merge_4, Closed=False)  # -> flatten(Polyline)
medges = MeshEdges(Mesh=tri.Mesh)  # -> NakedEdges, InteriorEdges, NonManifoldEdges
line = Line(pline)
trim = TrimWithRegion(Curve=line, Region=srf)  # -> flatten(Inside), Outside

mesh = Mesh(tri.Mesh)
vernum = Number(lng_2)
direction = Line(trim.Inside)
upleftbasept = Point(dispatch.ListB)

direction_2 = ClusterOutput(direction)
upleftbasept_2 = ClusterOutput(upleftbasept)
vernum_2 = ClusterOutput(vernum)
mesh_2 = ClusterOutput(mesh)

# ==== cluster Shifthalf
crv = ClusterInput()
P = ClusterInput()
crv_cp = CurveClosestPoint(Point=P, Curve=crv)  # -> Point, Parameter, Distance
shift = ShiftList(List=crv_cp.Parameter, Shift=1, Wrap=True)
addition = Addition(A=shift, B=crv_cp.Parameter)
division = Division(A=addition, B=2)
lng = ListLength(List=division)
num = Number(1)
subtraction = Subtraction(A=lng, B=num)
split = SplitList(List=division, Index=subtraction)  # -> ListA, ListB
eval = EvaluateCurve(Curve=crv, Parameter=split.ListA)  # -> Point, Tangent, Angle
P_2 = ClusterOutput(eval.Point)

# ==== cluster Cluster_7
crv1 = ClusterInput()
t1 = ClusterInput()
crv2 = ClusterInput()
t2 = ClusterInput()
item = ListItem(List=t1, Index=0, Wrap=True)
item_2 = ListItem(List=t2, Index=0, Wrap=True)
item_3 = ListItem(List=t1, Index=1, Wrap=True)
item_4 = ListItem(List=t2, Index=1, Wrap=True)
cluster = Cluster_6(C=crv1, B_2=item, B=item_3)
ccx = CurveCurve(CurveA=crv1, CurveB=crv2)  # -> Points, ParamsA, ParamsB
cluster_2 = Cluster_6(C=crv2, B_2=item_2, B=item_4)
pt = Point(ccx.Points)
rulesrf = RuledSurface(CurveA=cluster, CurveB=cluster_2)
S = ClusterOutput(rulesrf)

# ==== cluster Cluster_8
innercrv = ClusterInput()
outercrv = ClusterInput()
end = EndPoints(Curve=innercrv)  # -> Start, End
flip = FlipCurve(Curve=innercrv)  # -> Curve, Flag
flip_2 = FlipCurve(Curve=outercrv)  # -> Curve, Flag
clscrv = CloseCurve(Curve=outercrv, CloseType=0, Bulge=0.5, Tolerance=0)  # -> Closed, R
merge = Merge(Data1=innercrv, Data2=flip.Curve)
xy = XYPlane(Origin=Point(0, 0, 0))
offset = OffsetCurve(Curve=clscrv.Closed, Distance=1, Plane=xy, Corners=1)
area = Area(Geometry=clscrv.Closed)  # -> Area, Centroid
area_2 = Area(Geometry=offset)  # -> Area, Centroid
merge_2 = Merge(Data1=outercrv, Data2=flip_2.Curve)
smaller = SmallerThan(FirstNumber=area_2.Area, SecondNumber=area.Area)  # -> SmallerThan, OrEqualTo
not = GateNot(A=smaller.SmallerThan)
merge_3 = Merge(Data1=not, Data2=smaller.SmallerThan)
dispatch = Dispatch(List=merge_2, DispatchPattern=merge_3)  # -> ListA, ListB
xy_2 = XYPlane(Origin=Point(0, 0, 0))
end_2 = EndPoints(Curve=dispatch.ListB)  # -> Start, End
dist = Distance(PointA=end_2.Start, PointB=end.End)
dist_2 = Distance(PointA=end_2.Start, PointB=end.Start)
smaller_2 = SmallerThan(FirstNumber=dist_2, SecondNumber=dist)  # -> SmallerThan, OrEqualTo
not_2 = GateNot(A=smaller_2.SmallerThan)
merge_4 = Merge(Data1=smaller_2.SmallerThan, Data2=not_2)
dispatch_2 = Dispatch(List=merge, DispatchPattern=merge_4)  # -> ListA, ListB
offset_2 = OffsetCurve(Curve=dispatch.ListB, Distance=1, Plane=xy_2, Corners=1)
pt = Point(end_2.Start)
innercrv_2 = ClusterOutput(dispatch_2.ListA)
outercrv_2 = ClusterOutput(dispatch.ListB)

# ==== cluster Cluster_6
B = ClusterInput()
C = ClusterInput()
crvdom = CurveDomain(Curve=C)  # -> Curve, Domain
dedomain = DeconstructDomain(Domain=crvdom.Domain)  # -> Start, End
crvdom_2 = CurveDomain(Curve=C)  # -> Curve, Domain
addition = Addition(A=dedomain.Start, B=dedomain.End)
division = Division(A=addition, B=2)
smaller = SmallerThan(FirstNumber=division, SecondNumber=B)  # -> SmallerThan, OrEqualTo
not = GateNot(A=smaller.SmallerThan)
merge = Merge(Data1=smaller.SmallerThan, Data2=not)
dedomain_2 = DeconstructDomain(Domain=crvdom_2.Domain)  # -> Start, End
merge_2 = Merge(Data1=B, Data2=dedomain_2.End)  # -> flatten(Result)
B_2 = ClusterInput()
dispatch = Dispatch(List=reverse(merge_2), DispatchPattern=merge)  # -> ListA, ListB
larger = LargerThan(FirstNumber=division, SecondNumber=B_2)  # -> LargerThan, OrEqualTo
not_2 = GateNot(A=larger.LargerThan)
crvdom_3 = CurveDomain(Curve=C)  # -> Curve, Domain
merge_3 = Merge(Data1=larger.LargerThan, Data2=not_2)
dedomain_3 = DeconstructDomain(Domain=crvdom_3.Domain)  # -> Start, End
merge_4 = Merge(Data1=B_2, Data2=dedomain_3.Start)  # -> flatten(Result)
dispatch_2 = Dispatch(List=reverse(merge_4), DispatchPattern=merge_3)  # -> ListA, ListB
dom = ConstructDomain(DomainStart=dispatch_2.ListA, DomainEnd=dispatch.ListA)
subcrv = SubCurve(BaseCurve=crvdom_2.Curve, Domain=dom)
C_2 = ClusterOutput(subcrv)
crv = Curve(subcrv)
