# Grasshopper definition test.gh (Grasshopper 1.0.7)
# plug-ins: GHUI

file_path = FilePath("D:\Documents\Project\yinhua\gh-web-ui\custom-usage\pages\project\index.html")
panel = Panel(file_path)
launch_html_ui = LaunchHTMLUI(HTMLPath=file_path, ShowWindow=Toggle(False), Title="UI")  # -> InputValues, InputIds, InputNames, InputTypes, WebWindow
